# Grasshopper definition RationalForms_AtomicConcept_05.gh (Grasshopper 1.0.8)
# plug-ins: RhinoCodePluginGH, Pterodactyl

# Line effect on Area Divisions and proposionality for different conceptual spaces
panel = Panel("Base Curve")  # disabled
# Curve effect on Area Divisions and proposionality for different conceptual spaces
panel_2 = Panel("Base Curve")  # disabled
crv = Curve(<curve referenced from the Rhino model>)  # disabled
crv_2 = Curve(<curve referenced from the Rhino model>)  # disabled
number_slider = Slider(0.2, range=0..10)  # disabled
number_slider_2 = Slider(5, range=0..10)  # disabled
number_slider_3 = Slider(10, range=0..10)  # disabled
number_slider_4 = Slider(1.77, range=0..10)  # disabled
Y = UnitY(Factor=expr("-x", number_slider))  # disabled
crv_3 = Curve(crv)  # disabled
Y_2 = UnitY(Factor=number_slider)  # disabled
Y_3 = UnitY(Factor=expr("-x", number_slider_3))  # disabled
divide = DivideCurve(Curve=crv_2, Count=number_slider_2, Kinks=False)  # -> Points, Tangents, Parameters; disabled
Y_4 = UnitY(Factor=number_slider_3)  # disabled
offset = OffsetCurve(Curve=crv_2, Distance=expr("-x", Y), Plane=PlaneXY(0, 0, 0), Corners=1)  # disabled
offset_2 = OffsetCurve(Curve=crv_2, Distance=Y_2, Plane=PlaneXY(0, 0, 0), Corners=1)  # disabled
offset_3 = OffsetCurve(Curve=crv_2, Distance=expr("-x", Y_3), Plane=PlaneXY(0, 0, 0), Corners=1)  # disabled
offset_4 = OffsetCurve(Curve=crv_2, Distance=Y_4, Plane=PlaneXY(0, 0, 0), Corners=1)  # disabled
area = Area(Geometry=crv)  # -> Area, Centroid; disabled
offset_5 = OffsetCurve(Curve=crv_3, Distance=number_slider_4, Plane=crv_3, Corners=1)  # disabled
pt = Point(divide.Points)  # disabled
loft = Loft(
    Curves=flatten([offset_2, offset]),
    Options={Adjust=False, Closed=False, LoftEnds=0, LoftSimp=0, LoftType=0, Rebuild=10, Refit=0.01})  # disabled
loft_2 = Loft(
    Curves=flatten([offset_3, crv_2]),
    Options={Adjust=False, Closed=False, LoftEnds=0, LoftSimp=0, LoftType=0, Rebuild=10, Refit=0.01})  # disabled
number_slider_5 = Slider(6, range=0..10)  # disabled
number_slider_6 = Slider(2, range=0..10)  # disabled
loft_3 = Loft(
    Curves=flatten([offset_4, crv_2]),
    Options={Adjust=False, Closed=False, LoftEnds=0, LoftSimp=0, LoftType=0, Rebuild=10, Refit=0.01})  # disabled
number_slider_7 = Slider(1.17, range=0..10)  # disabled
number_slider_8 = Slider(2.97, range=0..10)  # disabled
number_slider_9 = Slider(1.6, range=0..10)  # disabled
number_slider_10 = Slider(3.1, range=0..10)  # disabled
Z = UnitZ(Factor=number_slider_5)  # disabled
len = Length(Curve=crv_2)  # disabled
Z_2 = UnitZ(Factor=number_slider_10)  # disabled
scale = Scale(Geometry=crv, Center=area.Centroid, Factor=number_slider_8)  # -> Geometry, Transform; disabled
scale_2 = Scale(Geometry=offset_5, Center=area.Centroid, Factor=number_slider_7)  # -> Geometry, Transform; disabled
multiplication = Multiplication(A=len, B=number_slider_9)  # disabled
extr = Extrude(Base=loft, Direction=Z)  # disabled
extr_2 = Extrude(Base=loft_2, Direction=Z_2)  # disabled
Z_3 = UnitZ(Factor=number_slider_10)  # disabled
X = UnitX(Factor=expr("-2*x", multiplication))  # disabled
X_2 = UnitX(Factor=expr("-x", multiplication))  # disabled
extr_3 = Extrude(Base=loft_3, Direction=Z_3)  # disabled
move = Move(Geometry=extr, Motion=X)  # -> Geometry, Transform; disabled
move_2 = Move(Geometry=extr_2, Motion=X_2)  # -> Geometry, Transform; disabled
number_slider_11 = Slider(1.5, range=0..10)  # disabled
number_slider_12 = Slider(3.5, range=0..10)  # disabled
number_slider_13 = Slider(5.7, range=0..10)  # disabled
loft_4 = Loft(
    Curves=flatten([crv, scale.Geometry]),
    Options={Adjust=False, Closed=False, LoftEnds=0, LoftSimp=0, LoftType=0, Rebuild=10, Refit=0.01})  # disabled
loft_5 = Loft(
    Curves=flatten([offset_5, scale_2.Geometry]),
    Options={Adjust=False, Closed=False, LoftEnds=0, LoftSimp=0, LoftType=0, Rebuild=10, Refit=0.01})  # disabled
boundary = BoundarySurfaces(Edges=crv)  # disabled

colour = ColourPicker(PickedColour=RGBA(62, 150, 97, 156))  # disabled
preview = CustomPreview(Geometry=move.Geometry, Material=colour)  # disabled

panel_3 = Panel("Wall Mass")  # disabled

colour_2 = ColourPicker(PickedColour=RGBA(62, 150, 97, 156))  # disabled
preview_2 = CustomPreview(Geometry=move_2.Geometry, Material=colour_2)  # disabled

panel_4 = Panel("Lower-side Mass")  # disabled

colour_3 = ColourPicker(PickedColour=RGBA(62, 150, 97, 156))  # disabled
preview_3 = CustomPreview(Geometry=extr_3, Material=colour_3)  # disabled

panel_5 = Panel("Upper-side Mass")  # disabled
Z_4 = UnitZ(Factor=number_slider_11)  # disabled
Z_5 = UnitZ(Factor=number_slider_12)  # disabled
Z_6 = UnitZ(Factor=number_slider_13)  # disabled
extr_4 = Extrude(Base=loft_4, Direction=Z_4)  # disabled
extr_5 = Extrude(Base=loft_5, Direction=Z_5)  # disabled
extr_6 = Extrude(Base=boundary, Direction=Z_6)  # disabled

colour_4 = ColourPicker(PickedColour=RGBA(57, 158, 46, 155))  # disabled
preview_4 = CustomPreview(Geometry=extr_5, Material=colour_4)  # disabled

colour_5 = ColourPicker(PickedColour=RGBA(46, 78, 158, 157))  # disabled
preview_5 = CustomPreview(Geometry=extr_4, Material=colour_5)  # disabled

panel_6 = Panel("LinearMass")  # disabled
panel_7 = Panel("Outer Mass")  # disabled

colour_6 = ColourPicker(PickedColour=RGBA(62, 150, 97, 156))  # disabled
preview_6 = CustomPreview(Geometry=extr_6, Material=colour_6)  # disabled

panel_8 = Panel("Inner Mass")  # disabled
number_slider_14 = Slider(0.13, range=0..10)  # disabled
number_slider_15 = Slider(0.05, range=0..10)  # disabled
number_slider_16 = Slider(0.08, range=0..10)  # disabled
number_slider_17 = Slider(0.29, range=0..10)  # disabled
dom = ConstructDomain(DomainStart=expr("-x", number_slider_15), DomainEnd=number_slider_15)  # disabled
dom_2 = ConstructDomain(DomainStart=expr("-x", number_slider_14), DomainEnd=number_slider_14)  # disabled
dom_3 = ConstructDomain(DomainStart=expr("-x", number_slider_16), DomainEnd=number_slider_16)  # disabled
merge = Merge(Data1=Slider(1, range=0..10), Data2=Slider(0, range=0..10), Data3=Slider(3, range=0..10))
merge_2 = Merge(Data1=Slider(1, range=0..10), Data2=Slider(2, range=0..10), Data3=Slider(3, range=0..10))
merge_3 = Merge(Data1=Slider(1, range=0..10), Data2=Slider(2, range=0..10), Data3=Slider(3, range=0..10))
number_slider_18 = Slider(1.2, range=0..10)  # disabled
Z_7 = UnitZ(Factor=number_slider_17)  # disabled
X_3 = X(dom_3)  # disabled
Y_5 = Y(dom_2)  # disabled
Z_8 = Z(dom)  # disabled
number_slider_19 = Slider(0, range=0..10)  # disabled
number_slider_20 = Slider(0, range=0..10)  # disabled
number_slider_21 = Slider(0, range=0..10)  # disabled
box = DomainBox(Base=Z_7, X=X_3, Y=Y_5, Z=Z_8)  # disabled
number_slider_22 = Slider(1.2, range=0..10)  # disabled
number_slider_23 = Slider(1.2, range=0..10)  # disabled
merge_4 = Merge(Data1=merge, Data2=Slider(1, range=0..10))
merge_5 = Merge(Data1=merge_2, Data2=Slider(1, range=0..10))
merge_6 = Merge(Data1=merge_3, Data2=Slider(1, range=0..10))
merge_7 = Merge(Data1=Slider(0, range=0..10), Data2=Slider(1, range=0..10), Data3=Slider(0, range=0..10))
merge_8 = Merge(Data1=merge_7, Data4=Slider(1, range=0..10))
dom_4 = ConstructDomain(DomainStart=number_slider_18, DomainEnd=expr("-x", number_slider_18))  # disabled
number_slider_24 = Slider(1.25, range=0..10)  # disabled
pt_2 = ConstructPoint(XCoordinate=number_slider_19, YCoordinate=number_slider_20, ZCoordinate=number_slider_21)  # disabled
volume = Volume(Geometry=box)  # -> Volume, Centroid; disabled
number_slider_25 = Slider(0.1, range=0..1)  # disabled
xy = XYPlane(Origin=volume.Centroid)  # disabled
pt_3 = Point(pt_2)  # disabled
merge_9 = Merge(Data1=merge_4, Data2=merge_5, Data3=merge_6)
scale_nu = ScaleNU(Geometry=box, Plane=xy, ScaleX=number_slider_22, ScaleY=number_slider_23, ScaleZ=number_slider_18)  # -> Geometry, Transform; disabled
merge_10 = Merge(Data1=merge, Data2=merge_2, Data3=merge_3)
number_slider_26 = Slider(0.75, range=0..1, expression="-x")  # disabled
cir = Circle(Plane=pt_3, Radius=number_slider_25)  # disabled
colour_7 = ColourPicker(PickedColour=RGB(0, 0, 0))
number_slider_27 = Slider(0.25, range=0..1)  # disabled
number_slider_28 = Slider(0.5, range=0..1)  # disabled
pt_4 = ConstructPoint(XCoordinate=Slider(1, range=0..10), YCoordinate=Slider(1, range=0..10), ZCoordinate=Slider(0, range=0..10))
merge_11 = Merge(Data1=merge_9, Data2=merge_8)
debrep = DeconstructBrep(Brep=scale_nu.Geometry)  # -> Faces, Edges, Vertices; disabled
debrep_2 = DeconstructBrep(Brep=box)  # -> Faces, Edges, Vertices; disabled
boundary_2 = BoundarySurfaces(Edges=cir)  # disabled
Y_6 = UnitY(Factor=number_slider_26)  # disabled
number_slider_29 = Slider(0, range=0..1)  # disabled
cp = ClosestPoint(Point=debrep_2.Vertices, Cloud=debrep.Vertices)  # -> ClosestPoint, CPIndex, Distance; disabled
number_slider_30 = Slider(0.25, range=0..1)  # disabled
number_slider_31 = Slider(6, range=0..10)  # disabled
panel_9 = Panel(pt_4)
move_3 = Move(Geometry=boundary_2, Motion=Y_6)  # -> Geometry, Transform; disabled
preview_7 = CustomPreview(Geometry=boundary_2, Material=colour_7)  # disabled
eval = EvaluateCurve(Curve=reparameterize(debrep.Edges), Parameter=number_slider_28)  # -> Point, Tangent, Angle; disabled
eval_2 = EvaluateCurve(Curve=reparameterize(debrep_2.Edges), Parameter=number_slider_28)  # -> Point, Tangent, Angle; disabled
vec2pt = Vector2Pt(PointA=debrep_2.Vertices, PointB=cp.ClosestPoint, Unitize=False)  # -> Vector, Length; disabled
panel_10 = Panel("3 X 3")
panel_11 = Panel("4 X 4")
number_slider_32 = Slider(0, range=0..1)  # disabled
matrix = ConstructMatrix(Rows=Slider(3, range=0..10), Columns=Slider(3, range=0..10), Values=merge_10)
multiplication_2 = Multiplication(A=matrix, B=pt_4)
matrix_2 = ConstructMatrix(Rows=Slider(4, range=0..10), Columns=Slider(4, range=0..10), Values=merge_11)
area_2 = Area(Geometry=debrep.Faces)  # -> Area, Centroid; disabled
area_3 = Area(Geometry=debrep_2.Faces)  # -> Area, Centroid; disabled
number_slider_33 = Slider(6, range=0..10)  # disabled
series = Series(Start=number_slider_29, Step=number_slider_27, Count=number_slider_31)  # disabled
number_slider_34 = Slider(0.75, range=0..1, expression="-x")  # disabled
number_slider_35 = Slider(0.03, range=0..0.1)  # disabled
move_4 = Move(Geometry=debrep_2.Vertices, Motion=vec2pt.Vector)  # -> Geometry, Transform; disabled
X_4 = UnitX(Factor=series)  # disabled
matrix_3 = DisplayMatrix(multiplication_2, Digits=2)
vec2pt_2 = Vector2Pt(PointA=area_3.Centroid, PointB=area_2.Centroid, Unitize=False)  # -> Vector, Length; disabled
vec2pt_3 = Vector2Pt(PointA=eval_2.Point, PointB=eval.Point, Unitize=False)  # -> Vector, Length; disabled
matrix_4 = DisplayMatrix(matrix_2, Digits=2)
matrix_5 = DisplayMatrix(matrix, Digits=2)
series_2 = Series(Start=number_slider_32, Step=expr("-x", number_slider_30), Count=number_slider_33)  # disabled
panel_12 = Panel(multiplication_2)
move_5 = Move(Geometry=move_3.Geometry, Motion=X_4)  # -> Geometry, Transform; disabled
Y_7 = UnitY(Factor=number_slider_26)  # disabled
sph = Sphere(Base=move_4.Geometry, Radius=number_slider_35)  # disabled
move_6 = Move(Geometry=debrep_2.Edges, Motion=vec2pt_3.Vector)  # -> Geometry, Transform; disabled
move_7 = Move(Geometry=debrep_2.Faces, Motion=vec2pt_2.Vector)  # -> Geometry, Transform; disabled
Y_8 = UnitY(Factor=series_2)  # disabled
move_8 = Move(Geometry=move_5.Geometry, Motion=Y_7)  # -> graft(Geometry), Transform; disabled
move_9 = Move(Geometry=move_8.Geometry, Motion=Y_8)  # -> Geometry, Transform; disabled
preview_8 = CustomPreview(Geometry=move_5.Geometry, Material=colour_7)  # disabled
cyl = Cylinder(Base=move_6.Geometry, Radius=expr(".5*x", number_slider_35), Length=move_6.Geometry)  # disabled
preview_9 = CustomPreview(Geometry=sph, Material=colour_7)  # disabled
preview_10 = CustomPreview(Geometry=move_9.Geometry, Material=colour_7)  # disabled
cap = CapHoles(Brep=cyl)  # disabled
colour_8 = ColourPicker(PickedColour=RGBA(0, 0, 0, 103))  # disabled
preview_11 = CustomPreview(Geometry=box, Material=colour_8)  # disabled
preview_12 = CustomPreview(Geometry=cap, Material=colour_7)  # disabled
number_slider_36 = Slider(2.5, range=0..10)
number_slider_37 = Slider(5, range=0..10)
S = Size(number_slider_36)
cluster = Cluster(A=S, B=number_slider_37)
number_slider_38 = Slider(2, range=0..10)
merge_12 = Merge(Data1=Slider(0, range=0..10), Data2=Slider(-1, range=-10..10), Data3=Slider(0, range=0..10))
merge_13 = Merge(Data1=Slider(1, range=-10..10), Data2=Slider(0, range=0..10), Data3=Slider(0, range=0..10))
merge_14 = Merge(Data1=Slider(0, range=0..10), Data2=Slider(0, range=0..10), Data3=Slider(0, range=0..10))
xy_2 = XYPlane(Origin=cluster)
multiplication_3 = Multiplication(A=number_slider_36, B=number_slider_37)
merge_15 = Merge(Data1=merge_12, Data2=Slider(1, range=0..10))
merge_16 = Merge(Data1=merge_13, Data2=Slider(1, range=0..10))
merge_17 = Merge(Data1=merge_14, Data2=Slider(1, range=0..10))
merge_18 = Merge(Data1=Slider(0, range=0..10), Data2=Slider(1, range=0..10), Data3=Slider(0, range=0..10))
merge_19 = Merge(Data1=merge_18, Data4=Slider(1, range=0..10))
sqgrid = Square(Plane=xy_2, Size=S, ExtentX=number_slider_37, ExtentY=Slider(5, range=0..10))  # -> Cells, Points
panel_13 = Panel("W_z")
integer_division = IntegerDivision(A=multiplication_3, B=number_slider_38)
division = Division(A=multiplication_3, B=number_slider_38)
flatten = FlattenTree(Tree=sqgrid.Points, Path="{0}")
series_3 = Series(Start=expr("-x", division), Step=number_slider_36, Count=expr("x+1", number_slider_37))
merge_20 = Merge(Data1=merge_15, Data2=merge_16, Data3=merge_17)
cullpt = CullDuplicates(Points=flatten, Tolerance=0.1, CullMode=3)  # -> Points, Indices, Valence
Z_9 = UnitZ(Factor=series_3)  # -> graft(UnitVector)
merge_21 = Merge(Data1=merge_12, Data2=merge_13, Data3=merge_14)
move_10 = Move(Geometry=cullpt.Points, Motion=Z_9)  # -> flatten(Geometry), Transform
merge_22 = Merge(Data1=merge_20, Data2=merge_19)
pt_5 = Point(move_10.Geometry)
matrix_6 = ConstructMatrix(Rows=Slider(3, range=0..10), Columns=Slider(3, range=0..10), Values=merge_21)
multiplication_4 = Multiplication(A=pt_5, B=matrix_6)
dematrix = DeconstructMatrix(Matrix=multiplication_4)  # -> Rows, Columns, simplify(Values)
num2pt = NumbersToPoints(Numbers=dematrix.Values, Mask=4)  # -> simplify(flatten(Points))
vec2pt_4 = Vector2Pt(PointA=simplify(flatten(pt_5)), PointB=num2pt, Unitize=True)  # -> Vector, Length
matrix_7 = ConstructMatrix(Rows=Slider(4, range=0..10), Columns=Slider(4, range=0..10), Values=merge_22)
move_11 = Move(Geometry=pt_5, Motion=vec2pt_4.Vector)  # -> Geometry, Transform

colour_9 = ColourPicker(PickedColour=RGB(2, 0, 186))
vdisex = VectorDisplayEx(Point=pt_5, Vector=vec2pt_4.Vector, Colour=colour_9, Width=2)
txt = Text("XY--z")
tag = TextTag(Location=move_11.Geometry, Text=txt, Colour=colour_9)

vdis = VectorDisplay(Anchor=pt_5, Vector=vec2pt_4.Vector)
matrix_8 = DisplayMatrix(matrix_7, Digits=2)
matrix_9 = DisplayMatrix(matrix_6, Digits=2)
panel_17 = Panel("W_y")
panel_18 = Panel("W_x")
number_slider_39 = Slider(2.5, range=0..10)
matrix_10 = Matrix(matrix_6)
number_slider_40 = Slider(5, range=0..10)
panel_19 = Panel("Relative Coordinates")
panel_20 = Panel("verbs")
panel_21 = Panel("Rotate Operator")
panel_22 = Panel("Mirror Operator")
panel_23 = Panel("Scale (Stretch) Operator")
panel_25 = Panel("Move Operator")
S_2 = Size(number_slider_39)
merge_23 = Merge(Data1=Slider(1, range=0..10), Data2=Slider(0, range=0..10), Data3=Slider(0, range=0..10))
merge_24 = Merge(Data1=Slider(0, range=0..10), Data2=Slider(1, range=0..10), Data3=Slider(0, range=0..10))
merge_25 = Merge(Data1=Slider(0, range=0..10), Data2=Slider(0, range=0..10), Data3=Slider(1, range=0..10))
cluster_2 = Cluster(A=S_2, B=number_slider_40)
number_slider_41 = Slider(2, range=0..10)
number_slider_42 = Slider(0.41, range=0..1)
# base multipliers (the Lie Algebraic vector space)
number_slider_43 = Slider(-0.91, range=-10..10)
number_slider_44 = Slider(0.1, range=0..1)
xy_3 = XYPlane(Origin=cluster_2)
multiplication_5 = Multiplication(A=number_slider_39, B=number_slider_40)
merge_26 = Merge(Data1=Slider(0, range=0..10), Data2=Slider(0, range=-10..10), Data3=Slider(1, range=0..10))
merge_27 = Merge(Data1=Slider(0, range=-10..10), Data2=Slider(0, range=0..10), Data3=Slider(0, range=0..10))
merge_28 = Merge(Data1=Slider(-1, range=-10..10), Data2=Slider(0, range=0..10), Data3=Slider(0, range=-10..10))
matrix_11 = Matrix(matrix_10)
matrix_12 = Matrix(matrix_10)
sqgrid_2 = Square(Plane=xy_3, Size=S_2, ExtentX=number_slider_40, ExtentY=Slider(5, range=0..10))  # -> Cells, Points
integer_division_2 = IntegerDivision(A=multiplication_5, B=number_slider_41)
division_2 = Division(A=multiplication_5, B=number_slider_41)
flatten_2 = FlattenTree(Tree=sqgrid_2.Points, Path="{0}")
merge_29 = Merge(Data1=merge_26, Data2=Slider(1, range=0..10))
merge_30 = Merge(Data1=merge_27, Data2=Slider(1, range=0..10))
merge_31 = Merge(Data1=merge_28, Data2=Slider(1, range=0..10))
merge_32 = Merge(Data1=Slider(0, range=0..10), Data2=Slider(1, range=0..10), Data3=Slider(0, range=0..10))
merge_33 = Merge(Data1=merge_32, Data4=Slider(1, range=0..10))
merge_34 = Merge(Data1=merge_23, Data2=merge_24, Data3=merge_25)
series_4 = Series(Start=expr("-x", division_2), Step=number_slider_39, Count=expr("x+1", number_slider_40))
multiplication_6 = Multiplication(A=matrix_11, B=number_slider_43)
number_slider_45 = Slider(2.5, range=0..10)
multiplication_7 = Multiplication(A=matrix_12, B=Slider(0.51, range=0..1))
# Lie Bracket [X , Y]
# 
# e^X e^Y = e^Z (calculate Z)
number_slider_46 = Slider(5, range=0..10)
number_slider_47 = Slider(5, range=0..10)
cullpt_2 = CullDuplicates(Points=flatten_2, Tolerance=0.1, CullMode=3)  # -> Points, Indices, Valence
# Lie Bracket [X , Y]
# 
# e^X e^Y = e^Z (calculate Z)
number_slider_48 = Slider(4, range=0..10)
number_slider_49 = Slider(4, range=0..10)
matrix_13 = DisplayMatrix(multiplication_6, Digits=2)
Z_10 = UnitZ(Factor=series_4)  # -> graft(UnitVector)
merge_35 = Merge(Data1=merge_29, Data2=merge_30, Data3=merge_31)
move_12 = Move(Geometry=cullpt_2.Points, Motion=Z_10)  # -> flatten(Geometry), Transform
panel_27 = Panel("Identity Matrix ")
panel_28 = Panel("Y")
panel_29 = Panel("X")
S_3 = Size(number_slider_45)
S_4 = Size(Slider(2, range=0..10))
matrix_14 = Matrix(multiplication_6)
matrix_15 = Matrix(multiplication_7)
pt_6 = Point(move_12.Geometry)
merge_36 = Merge(Data1=merge_26, Data2=merge_27, Data3=merge_28)
merge_37 = Merge(Data1=merge_35, Data2=merge_33)
panel_31 = Panel("Between Point-world")
panel_32 = Panel("Between Points")
panel_33 = Panel("Targetted Rotate Lgorithm")
panel_34 = Panel("Targetted Mirror Lgorithm")
cluster_3 = Cluster(A=S_3, B=number_slider_47)
panel_37 = Panel("Targetted Move Lgorithm")
cluster_4 = Cluster(A=S_4, B=number_slider_49)
number_slider_50 = Slider(2, range=0..10)
matrix_16 = ConstructMatrix(Rows=Slider(3, range=0..10), Columns=Slider(3, range=0..10), Values=merge_34)
xy_4 = XYPlane(Origin=cluster_3)
xy_5 = XYPlane(Origin=cluster_4)
multiplication_8 = Multiplication(A=number_slider_45, B=number_slider_47)
matrix_17 = DisplayMatrix(matrix_16, Digits=2)
sqgrid_3 = Square(Plane=xy_4, Size=S_3, ExtentX=number_slider_47, ExtentY=number_slider_46)  # -> Cells, Points
integer_division_3 = IntegerDivision(A=multiplication_8, B=number_slider_50)
sqgrid_4 = Square(Plane=xy_5, Size=S_4, ExtentX=number_slider_49, ExtentY=number_slider_48)  # -> Cells, Points
division_3 = Division(A=multiplication_8, B=number_slider_50)
matrix_18 = ConstructMatrix(Rows=Slider(3, range=0..10), Columns=Slider(3, range=0..10), Values=merge_36)
matrix_19 = Matrix(matrix_18)
matrix_20 = Matrix(matrix_19)
matrix_21 = Matrix(matrix_19)
multiplication_9 = Multiplication(A=matrix_20, B=Slider(-1.05, range=-10..10))
multiplication_10 = Multiplication(A=matrix_21, B=Slider(0.22, range=0..1))
matrix_22 = DisplayMatrix(multiplication_9, Digits=2)
multiplication_11 = Multiplication(A=pt_6, B=matrix_18)
dematrix_2 = DeconstructMatrix(Matrix=multiplication_11)  # -> Rows, Columns, simplify(Values)
matrix_23 = Matrix(multiplication_9)
matrix_24 = Matrix(multiplication_10)
num2pt_2 = NumbersToPoints(Numbers=dematrix_2.Values, Mask=4)  # -> simplify(flatten(Points))
vec2pt_5 = Vector2Pt(PointA=simplify(flatten(pt_6)), PointB=num2pt_2, Unitize=True)  # -> Vector, Length
addition = Addition(A=matrix_14, B=matrix_23)
addition_2 = Addition(A=matrix_24, B=matrix_15)
move_13 = Move(Geometry=pt_6, Motion=vec2pt_5.Vector)  # -> Geometry, Transform
vdis_2 = VectorDisplay(Anchor=pt_6, Vector=vec2pt_5.Vector)
matrix_25 = ConstructMatrix(Rows=Slider(4, range=0..10), Columns=Slider(4, range=0..10), Values=merge_37)

colour_10 = ColourPicker(PickedColour=RGB(255, 0, 102))
vdisex_2 = VectorDisplayEx(Point=pt_6, Vector=vec2pt_5.Vector, Colour=colour_10, Width=2)
txt_2 = Text("XY--z")
tag_2 = TextTag(Location=move_13.Geometry, Text=txt_2)

flatten_3 = FlattenTree(Tree=sqgrid_3.Points, Path="{0}")
multiplication_12 = Multiplication(A=matrix_14, B=matrix_23)
series_5 = Series(Start=expr("-x", division_3), Step=number_slider_45, Count=expr("x+1", number_slider_47))
flatten_4 = FlattenTree(Tree=sqgrid_4.Points, Path="{0}")
multiplication_13 = Multiplication(A=matrix_24, B=matrix_15)
cullpt_3 = CullDuplicates(Points=flatten_3, Tolerance=0.1, CullMode=3)  # -> Points, Indices, Valence
multiplication_14 = Multiplication(A=matrix_23, B=matrix_14)
matrix_26 = DisplayMatrix(matrix_25, Digits=2)
cullpt_4 = CullDuplicates(Points=flatten_4, Tolerance=0.1, CullMode=3)  # -> Points, Indices, Valence
matrix_27 = DisplayMatrix(matrix_18, Digits=2)
Z_11 = UnitZ(Factor=series_5)  # -> graft(UnitVector)
multiplication_15 = Multiplication(A=matrix_15, B=matrix_24)
move_14 = Move(Geometry=cullpt_3.Points, Motion=Z_11)  # -> flatten(Geometry), Transform
panel_40 = Panel("[X,Y]")
subtraction = Subtraction(A=multiplication_12, B=multiplication_14)
matrix_28 = DisplayMatrix(subtraction, Digits=2)
subtraction_2 = Subtraction(A=multiplication_13, B=multiplication_15)
multiplication_16 = Multiplication(A=cullpt_4.Points, B=subtraction_2)
dematrix_3 = DeconstructMatrix(Matrix=multiplication_16)  # -> Rows, Columns, simplify(Values)
pt_7 = Point(move_14.Geometry)
num2pt_3 = NumbersToPoints(Numbers=dematrix_3.Values, Mask=4)  # -> simplify(flatten(Points))
multiplication_17 = Multiplication(A=subtraction, B=Slider(0.5, range=0..1))
vec2pt_6 = Vector2Pt(PointA=simplify(flatten(cullpt_4.Points)), PointB=num2pt_3, Unitize=True)  # -> Vector, Length
multiplication_18 = Multiplication(A=subtraction_2, B=Slider(0.5, range=0..1))
panel_42 = Panel("Z^0")
multiplication_19 = Multiplication(A=vec2pt_6.Vector, B=Slider(2.5, range=0..10))
matrix_29 = Matrix(matrix_16)
colour_11 = ColourPicker(PickedColour=RGB(120, 116, 91))
panel_43 = Panel("t")
panel_44 = Panel("Z")
addition_3 = Addition(A=addition, B=multiplication_17)
multiplication_20 = Multiplication(A=pt_7, B=addition_3)
dematrix_4 = DeconstructMatrix(Matrix=multiplication_20)  # -> Rows, Columns, simplify(Values)
num2pt_4 = NumbersToPoints(Numbers=dematrix_4.Values, Mask=4)  # -> simplify(flatten(Points))
vec2pt_7 = Vector2Pt(PointA=simplify(flatten(pt_7)), PointB=num2pt_4, Unitize=True)  # -> Vector, Length
move_15 = Move(Geometry=pt_7, Motion=vec2pt_7.Vector)  # -> Geometry, Transform
vdis_3 = VectorDisplay(Anchor=pt_7, Vector=vec2pt_7.Vector)
number_slider_51 = Slider(1, range=0..10)
merge_38 = Merge(Data1=Slider(0, range=0..10), Data2=Slider(0, range=-10..10), Data3=Slider(0, range=0..10))
merge_39 = Merge(Data1=Slider(0, range=-10..10), Data2=Slider(0, range=0..10), Data3=Slider(-1, range=-10..10))
merge_40 = Merge(Data1=Slider(0, range=-10..10), Data2=Slider(1, range=0..10), Data3=Slider(0, range=-10..10))
move_16 = Move(Geometry=cullpt_4.Points, Motion=multiplication_19)  # -> Geometry, Transform

colour_12 = ColourPicker(PickedColour=RGBA(140, 130, 0, 174))
vdisex_3 = VectorDisplayEx(Point=cullpt_4.Points, Vector=multiplication_19, Colour=colour_12, Width=2)
txt_3 = Text("[Y,X]")
tag_3 = TextTag(Location=move_16.Geometry, Text=txt_3, Colour=colour_12)

addition_4 = Addition(A=addition_2, B=multiplication_18)

vdisex_4 = VectorDisplayEx(Point=pt_7, Vector=vec2pt_7.Vector, Colour=colour_11, Width=2)
txt_4 = Text("XY--z")
tag_4 = TextTag(Location=move_15.Geometry, Text=txt_4)

matrix_30 = DisplayMatrix(matrix_29, Digits=2)
panel_47 = Panel("calculate e^tZ")
matrix_31 = Matrix(addition_4)
matrix_32 = DisplayMatrix(subtraction_2, Digits=2)
matrix_33 = DisplayMatrix(addition_3, Digits=2)
range = Range(Domain=Domain(0, 1), Steps=Slider(8, range=0..15))  # -> graft(Range)
number_slider_52 = Slider(2.5, range=0..10)
number_slider_53 = Slider(5, range=0..10)
multiplication_21 = Multiplication(A=matrix_31, B=range)
merge_41 = Merge(Data1=merge_38, Data2=Slider(1, range=0..10))
merge_42 = Merge(Data1=merge_39, Data2=Slider(1, range=0..10))
merge_43 = Merge(Data1=merge_40, Data2=Slider(1, range=0..10))
merge_44 = Merge(Data1=Slider(0, range=0..10), Data2=Slider(1, range=0..10), Data3=Slider(0, range=0..10))
merge_45 = Merge(Data1=merge_44, Data4=Slider(1, range=0..10))
panel_48 = Panel("tZ^1")
matrix_34 = DisplayMatrix(multiplication_21, Digits=2)
matrix_35 = Matrix(matrix_10)
merge_46 = Merge(Data1=merge_41, Data2=merge_42, Data3=merge_43)
S_5 = Size(number_slider_52)
matrix_36 = DisplayMatrix(matrix_31, Digits=2)
panel_50 = Panel("training ")
path = FilePath("C:\Users\mmaez\OneDrive\arc_agi\arc-prize-2024\arc-agi_training_challenges.json")
path_2 = FilePath("C:\Users\mmaez\OneDrive\arc_agi\arc-prize-2024\arc-agi_training_solutions.json")
cluster_5 = Cluster(A=S_5, B=number_slider_53)
merge_47 = Merge(Data1=merge_38, Data2=merge_39, Data3=merge_40)
merge_48 = Merge(Data1=merge_46, Data2=merge_45)
number_slider_54 = Slider(2, range=0..10)
multiplication_22 = Multiplication(A=number_slider_51, B=number_slider_51)
addition_5 = Addition(A=multiplication_21, B=matrix_29)
multiplication_23 = Multiplication(A=matrix_31, B=matrix_31)
xy_6 = XYPlane(Origin=cluster_5)
panel_51 = Panel("evaluation")
number_slider_55 = Slider(4, range=0..10)
matrix_37 = DisplayMatrix(multiplication_23, Digits=2)
multiplication_24 = Multiplication(A=number_slider_52, B=number_slider_53)
matrix_38 = DisplayMatrix(addition_5, Digits=2)
multiplication_25 = Multiplication(A=multiplication_23, B=multiplication_22)
path_3 = FilePath("C:\Users\mmaez\OneDrive\arc_agi\arc-prize-2024\arc-agi_evaluation_challenges.json")
path_4 = FilePath("C:\Users\mmaez\OneDrive\arc_agi\arc-prize-2024\arc-agi_evaluation_solutions.json")
sqgrid_5 = Square(Plane=xy_6, Size=S_5, ExtentX=number_slider_53, ExtentY=Slider(5, range=0..10))  # -> Cells, Points
integer_division_4 = IntegerDivision(A=multiplication_24, B=number_slider_54)
division_4 = Division(A=multiplication_24, B=number_slider_54)
dematrix_5 = DeconstructMatrix(Matrix=addition_2)  # -> Rows, Columns, Values
matrix_39 = DisplayMatrix(multiplication_25, Digits=2)
panel_52 = Panel("1/fact(2) (tZ^2)")

panel_53 = Panel("Identity")
identity_matrix = Python3Script(n=number_slider_55)  # -> out, a; inputs n: Int32
# ---------- identity_matrix: Python ----------
"""Grasshopper Script"""
#requirements: NumPy 

import System
import Rhino
import Grasshopper

import rhinoscriptsyntax as rs
import numpy as np
import ghpythonlib as gh


class MyComponent(Grasshopper.Kernel.GH_ScriptInstance):
    def RunScript(self, n: int):
        

        
        id = np.identity(n)
        id = id.flatten()
        
        
        #a = id
        #ind=0
        b=list()
        
        

        for i in range(n*n):
            b.append(id[i])
            #ind += 1

        
        
        
        
       # a = "Hello Python 3 in Grasshopper!"
        #print(a)
        
        return  b
# ---------- end identity_matrix ----------

knob = ControlKnob(Decimals=0, Limit=True, Maximum=399, Minimum=0, Range=400, Value=66)
evaluation = BooleanToggle(False)
flatten_5 = FlattenTree(Tree=sqgrid_5.Points, Path="{0}")
fac = Factorial(Number=Slider(2, range=0..10))
matrix_40 = ConstructMatrix(Rows=Slider(3, range=0..10), Columns=Slider(3, range=0..10), Values=merge_47)
matrix_41 = Matrix(matrix_40)
matrix_42 = ConstructMatrix(Rows=Slider(4, range=0..10), Columns=Slider(4, range=0..10), Values=merge_48)
series_6 = Series(Start=expr("-x", division_4), Step=number_slider_52, Count=expr("x+1", number_slider_53))
cullpt_5 = CullDuplicates(Points=flatten_5, Tolerance=0.1, CullMode=3)  # -> Points, Indices, Valence

panel_56 = Panel("Inverse")
inverse_matrix = Python3Script(n=dematrix_5.Rows, x=dematrix_5.Values)  # -> out, a; inputs x: list of Double
# ---------- inverse_matrix: Python ----------
"""Grasshopper Script"""
#requirements: NumPy 

import System
import Rhino
import Grasshopper

import rhinoscriptsyntax as rs
import numpy as np
import ghpythonlib as gh


class MyComponent(Grasshopper.Kernel.GH_ScriptInstance):
    def RunScript(self, n, x: System.Collections.Generic.List[float]):
        

        
        ar = np.array(x)
        

        ar = np.reshape(ar, (n, n))
        ar = np.linalg.inv(ar)

        
        ar = ar.flatten()
        
        
        #a = id
        #ind=0
        b=list()
        
        

        for i in range(n*n):
            b.append(ar[i])
            #ind += 1

        
        
        
        
       # a = "Hello Python 3 in Grasshopper!"
        #print(a)
        
        return  b
# ---------- end inverse_matrix ----------

max = Maximum(A=knob, B=Slider(3, range=0..399))

determinant_matrix = Python3Script(n=dematrix_5.Rows, x=dematrix_5.Values)  # -> out, a; inputs n: Int32, x: list of Double
# ---------- determinant_matrix: Python ----------
"""Grasshopper Script"""
#requirements: NumPy 

import System
import Rhino
import Grasshopper

import rhinoscriptsyntax as rs
import numpy as np
import ghpythonlib as gh


class MyComponent(Grasshopper.Kernel.GH_ScriptInstance):
    def RunScript(self, n: int, x: System.Collections.Generic.List[float]):
        

        
        ar = np.array(x)
        

        ar = np.reshape(ar, (n, n))
        det = np.linalg.det(ar)

        #ar = ar.flatten()
        
        
        #a = id
        #ind=0
       # b=list()
        
        

        #for i in range(n*n):
          # b.append(ar[i])
            #ind += 1

        
        
        
        
       # a = "Hello Python 3 in Grasshopper!"
        #print(a)
        
        return  det
# ---------- end determinant_matrix ----------

Z_12 = UnitZ(Factor=series_6)  # -> graft(UnitVector)
division_5 = Division(A=Slider(1, range=0..1), B=fac)
p_n_c = PickNChoose(Pattern=evaluation, Stream0=path_2, Stream1=path_4)
p_n_c_2 = PickNChoose(Pattern=evaluation, Stream0=path, Stream1=path_3)
matrix_43 = ConstructMatrix(Rows=number_slider_55, Columns=number_slider_55, Values=identity_matrix.a)
matrix_44 = DisplayMatrix(matrix_42, Digits=2)
matrix_45 = DisplayMatrix(matrix_40, Digits=2)
move_17 = Move(Geometry=cullpt_5.Points, Motion=Z_12)  # -> flatten(Geometry), Transform
multiplication_26 = Multiplication(A=multiplication_25, B=division_5)
minvert = InvertMatrix(Matrix=multiplication_26, Tolerance=0)  # -> Matrix, Success
identity_matrix_2 = Python3Script(fl_challenge=p_n_c_2, fl_solution=p_n_c, n=max)  # -> out, tst_raws, tst_cols, tst_mat, sol_raws, sol_cols, sol_mat; inputs fl_challenge: String, fl_solution: String, n: Int32
#   port tst_raws: the challenge file size
# ---------- identity_matrix_2: Python ----------
"""Grasshopper Script"""
# requirements: NumPy

import System
import Rhino
import Grasshopper

import rhinoscriptsyntax as rs
import numpy as np
import ghpythonlib as gh

import json


class MyComponent(Grasshopper.Kernel.GH_ScriptInstance):
    def RunScript(self, fl_challenge: str, fl_solution: str, n: int):

        file_challenge = open(fl_challenge, "r")
        file_solution = open(fl_solution, "r")

        data_challenge = json.load(file_challenge)
        data_solution = json.load(file_solution)


        data_chal_keys = list(data_challenge.keys())
        #data_chal_keys[n]



        ###################### the input of the test of the challenge 
        #### Number of raws 
        test_raws = data_challenge[data_chal_keys[n]]["test"][0]["input"]
        print(len(test_raws))
        ### number of columns
        test_cols = data_challenge[data_chal_keys[n]]["test"][0]["input"][0]
        print(len(test_cols))

        print(data_challenge[data_chal_keys[n]]["test"])
        print(data_challenge[data_chal_keys[n]]["train"])


        ###################### the output of the test of the challenge as answered in the solution 
        data_sol_keys = list(data_solution.keys())
        #### Number of raws
        sol_raws = data_solution[data_sol_keys[n]][0]
        print(len(sol_raws))
        ### number of columns
        sol_cols = data_solution[data_sol_keys[n]][0][0]
        print(len(sol_cols))

        print(data_solution[data_sol_keys[n]])

        print(data_chal_keys[n])
        print(data_sol_keys[n])

        

        #d = data_challenge[5]
        d1 = data_challenge[data_chal_keys[n]]
        print(d1)

        

        #d11 = d1.keys()

        #d11["train"]

        #print(d11)
        #print(k1)
        #print(k2)

        l_challenge = len(data_challenge)
        l_solution = len(data_solution)

        print("Number of challenging samples:   " + str(l_challenge))
        print("Number of solution samples:   " + str(l_solution))

        ################# calculating the testing matrix of the testing space
        tst_mat=list()
        tst_np = np.array(data_challenge[data_chal_keys[n]]["test"][0]["input"]).flatten()

        print(tst_np)
        for i in range(len(test_raws)*len(test_cols)):
            tst_mat.append(int(tst_np[i]))


        ################# calculating the output matrix of the solution space
        sol_mat=list()
        sol_np = np.array(data_solution[data_sol_keys[n]]).flatten()
        
        print(sol_np)
        for i in range(len(sol_raws)*len(sol_cols)):
            sol_mat.append(int(sol_np[i]))


        ################## the main outputs
        return len(test_raws), len(test_cols), tst_mat, len(sol_raws), len(sol_cols), sol_mat #, l_challenge, l_solution
# ---------- end identity_matrix_2 ----------
matrix_46 = ConstructMatrix(Rows=dematrix_5.Rows, Columns=dematrix_5.Rows, Values=determinant_matrix.a)
pt_8 = Point(move_17.Geometry)
multiplication_27 = Multiplication(A=pt_8, B=matrix_40)
dematrix_6 = DeconstructMatrix(Matrix=multiplication_27)  # -> Rows, Columns, simplify(Values)
matrix_47 = DisplayMatrix(multiplication_26, Digits=2)
num2pt_5 = NumbersToPoints(Numbers=dematrix_6.Values, Mask=4)  # -> simplify(flatten(Points))
matrix_48 = DisplayMatrix(matrix_43)
multiplication_28 = Multiplication(A=multiplication_26, B=minvert.Matrix)
addition_6 = Addition(A=multiplication_26, B=addition_5)
vec2pt_8 = Vector2Pt(PointA=simplify(flatten(pt_8)), PointB=num2pt_5, Unitize=True)  # -> Vector, Length
matrix_49 = ConstructMatrix(Rows=identity_matrix_2.tst_raws, Columns=identity_matrix_2.tst_cols, Values=identity_matrix_2.tst_mat)
matrix_50 = ConstructMatrix(Rows=identity_matrix_2.sol_raws, Columns=identity_matrix_2.sol_cols, Values=identity_matrix_2.sol_mat)
multiplication_29 = Multiplication(A=matrix_31, B=multiplication_23)
multiplication_30 = Multiplication(A=number_slider_51, B=multiplication_22)
panel_57 = Panel("\usepackage{nicematrix}")  # disabled
matrix_51 = DisplayMatrix(addition_6, Digits=2)
colour_13 = ColourPicker(PickedColour=RGB(0, 255, 128))
move_18 = Move(Geometry=pt_8, Motion=vec2pt_8.Vector)  # -> Geometry, Transform
matrix_52 = DisplayMatrix(multiplication_29, Digits=2)
vdis_4 = VectorDisplay(Anchor=pt_8, Vector=vec2pt_8.Vector)
matrix_53 = DisplayMatrix(matrix_50)
matrix_54 = DisplayMatrix(matrix_49)

vdisex_5 = VectorDisplayEx(Point=pt_8, Vector=vec2pt_8.Vector, Colour=colour_13, Width=2)
txt_5 = Text("XY--z")
tag_5 = TextTag(Location=move_18.Geometry, Text=txt_5)

multiplication_31 = Multiplication(A=multiplication_29, B=multiplication_30)
multiplication_32 = Multiplication(A=identity_matrix_2.sol_raws, B=identity_matrix_2.sol_cols)
dynamic_math_block = DynamicMathBlock(Text=panel_57, VariablesSymbols=["x", "y"], VariablesValues=[1, 2])  # disabled
create_report = CreateReport(ReportParts=dynamic_math_block, Title="Determinant", TableOfContents=False, AutoSpacing=False)  # -> flatten(Report); disabled
panel_58 = Panel("1/fact(3) (tZ^3)")
number_slider_56 = Slider(5, range=0..10, expression="-x")  # disabled
number_slider_57 = Slider(3, range=1..12)
fac_2 = Factorial(Number=Slider(3, range=0..10))
xy_7 = XYPlane(Origin=Point(0, 0, 0))
xz = XZPlane(Origin=Point(0, 0, 0))
yz = YZPlane(Origin=Point(0, 0, 0))
d_google_drive_aaai_2025_matrices_latex = FilePath("D:\Google_Drive\AAAI_2025\Matrices\latex.md")  # "D:\Google_Drive\AAAI_2025\Matrices\latex.md"; disabled
division_6 = Division(A=Slider(1, range=0..1), B=fac_2)
multiplication_33 = Multiplication(A=identity_matrix_2.tst_raws, B=identity_matrix_2.tst_cols)
X_5 = UnitX(Factor=number_slider_56)  # disabled
division_7 = Division(A=Slider(360, range=0..1000), B=number_slider_57)
col = Colour(RGB(127, 219, 255))
col_2 = Colour(RGB(135, 12, 37))
col_3 = Colour(RGB(0, 0, 0))
col_4 = Colour(RGB(46, 204, 64))
col_5 = Colour(RGB(255, 133, 27))
col_6 = Colour(RGB(240, 18, 190))
col_7 = Colour(RGB(0, 116, 217))
col_8 = Colour(RGB(255, 65, 54))
col_9 = Colour(RGB(255, 220, 0))
col_10 = Colour(RGB(170, 170, 170))
Z_13 = UnitZ(Factor=number_slider_56)  # disabled
save_report = SaveReport(Report=create_report, Path=d_google_drive_aaai_2025_matrices_latex)  # disabled
panel_59 = Panel(identity_matrix_2.out)
series_7 = Series(Start=0, Step=division_7, Count=number_slider_57)
addition_7 = Addition(A=X_5, B=Z_13)  # disabled
multiplication_34 = Multiplication(A=multiplication_31, B=division_6)
rotate = Rotate(Geometry=yz, Angle=degrees(series_7), Plane=PlaneXY(0, 0, 0))  # -> Geometry, Transform
repeat = RepeatData(Data=col, Length=multiplication_32)
repeat_2 = RepeatData(Data=col_2, Length=multiplication_32)
repeat_3 = RepeatData(Data=col_5, Length=multiplication_32)
move_19 = Move(Geometry=xy_7, Motion=addition_7)  # -> Geometry, Transform; disabled
repeat_4 = RepeatData(Data=col_6, Length=multiplication_32)
repeat_5 = RepeatData(Data=col_4, Length=multiplication_32)
repeat_6 = RepeatData(Data=col_3, Length=multiplication_32)
repeat_7 = RepeatData(Data=col_9, Length=multiplication_32)
repeat_8 = RepeatData(Data=col_10, Length=multiplication_32)
repeat_9 = RepeatData(Data=col_7, Length=multiplication_32)
repeat_10 = RepeatData(Data=col_8, Length=multiplication_32)
repeat_11 = RepeatData(Data=col, Length=multiplication_33)
repeat_12 = RepeatData(Data=col_2, Length=multiplication_33)
repeat_13 = RepeatData(Data=col_5, Length=multiplication_33)
repeat_14 = RepeatData(Data=col_6, Length=multiplication_33)
repeat_15 = RepeatData(Data=col_4, Length=multiplication_33)
repeat_16 = RepeatData(Data=col_3, Length=multiplication_33)
repeat_17 = RepeatData(Data=col_9, Length=multiplication_33)
repeat_18 = RepeatData(Data=col_10, Length=multiplication_33)
repeat_19 = RepeatData(Data=col_7, Length=multiplication_33)
repeat_20 = RepeatData(Data=col_8, Length=multiplication_33)
addition_8 = Addition(A=multiplication_34, B=addition_6)
pt_9 = ConstructPoint(XCoordinate=0, YCoordinate=Slider(0, range=0..100), ZCoordinate=0)
matrix_55 = DisplayMatrix(addition_8, Digits=2)
Z_14 = UnitZ(Factor=10)  # disabled
number_slider_58 = Slider(1.9, range=0..10)
multiplication_35 = Multiplication(A=identity_matrix_2.tst_cols, B=number_slider_58)
addition_9 = Addition(A=multiplication_35, B=Slider(6, range=0..100))
pt_10 = ConstructPoint(XCoordinate=addition_9, YCoordinate=0, ZCoordinate=0)
line = LineSDL(Start=move_19.Geometry, Direction=Vector(3.268322667, 0, 0), Length=10)  # disabled
xy_8 = XYPlane(Origin=pt_10)
xy_9 = XYPlane(Origin=pt_9)
pt_11 = ConstructPoint(XCoordinate=0, YCoordinate=0, ZCoordinate=-1)
extr_7 = Extrude(Base=line, Direction=Z_14)  # disabled
multiplication_36 = Multiplication(A=number_slider_51, B=multiplication_30)
multiplication_37 = Multiplication(A=matrix_31, B=multiplication_29)
move_20 = Move(Geometry=debrep_2.Vertices, Motion=vec2pt.Vector)  # -> Geometry, Transform
sqgrid_6 = Square(Plane=xy_8, Size=number_slider_58, ExtentX=identity_matrix_2.sol_cols, ExtentY=identity_matrix_2.sol_raws)  # -> simplify(Cells), Points
p_n_c_3 = PickNChoose(
    Pattern=identity_matrix_2.sol_mat,
    Stream0=repeat_6,
    Stream1=repeat_9,
    Stream2=repeat_10,
    Stream3=repeat_5,
    Stream4=repeat_7,
    Stream5=repeat_8,
    Stream6=repeat_4,
    Stream7=repeat_3,
    Stream8=repeat,
    Stream9=repeat_2)
p_n_c_4 = PickNChoose(
    Pattern=identity_matrix_2.tst_mat,
    Stream0=repeat_16,
    Stream1=repeat_19,
    Stream2=repeat_20,
    Stream3=repeat_15,
    Stream4=repeat_17,
    Stream5=repeat_18,
    Stream6=repeat_14,
    Stream7=repeat_13,
    Stream8=repeat_11,
    Stream9=repeat_12)
sqgrid_7 = Square(Plane=xy_9, Size=number_slider_58, ExtentX=identity_matrix_2.tst_cols, ExtentY=identity_matrix_2.tst_raws)  # -> simplify(Cells), Points
number_slider_59 = Slider(0.03, range=0..0.1)
vec2pt_9 = Vector2Pt(PointA=eval_2.Point, PointB=eval.Point, Unitize=False)  # -> Vector, Length
multiplication_38 = Multiplication(A=multiplication_37, B=multiplication_36)
matrix_56 = DisplayMatrix(multiplication_37, Digits=2)
flip = FlipMatrix(Data=sqgrid_7.Cells)
flip_2 = FlipMatrix(Data=sqgrid_6.Cells)
number_slider_60 = Slider(5, range=0..10)  # disabled
move_21 = Move(Geometry=debrep_2.Edges, Motion=vec2pt_9.Vector)  # -> Geometry, Transform
panel_60 = Panel("1/fact(4) (tZ^4)")
debrep_3 = DeconstructBrep(Brep=flip)  # -> flatten(Faces), Edges, Vertices
debrep_4 = DeconstructBrep(Brep=flip_2)  # -> flatten(Faces), Edges, Vertices
merge_49 = Merge(Data1=Slider(5, range=0..10), Data2=Slider(3, range=0..10), Data3=Slider(7, range=0..10))  # -> graft(Result)
fac_3 = Factorial(Number=Slider(4, range=0..10))
panel_61 = Panel(p_n_c_3)
colour_14 = ColourPicker(PickedColour=RGB(0, 0, 0))
division_8 = Division(A=Slider(1, range=0..1), B=fac_3)
preview_13 = CustomPreview(Geometry=debrep_3.Faces, Material=p_n_c_4)
preview_14 = CustomPreview(Geometry=debrep_4.Faces, Material=p_n_c_3)
colour_15 = ColourPicker(PickedColour=RGBA(61, 186, 0, 202))
multiplication_39 = Multiplication(A=multiplication_38, B=division_8)
addition_10 = Addition(A=multiplication_39, B=addition_8)
colour_16 = ColourPicker(PickedColour=RGB(255, 0, 0))
matrix_57 = DisplayMatrix(addition_10, Digits=2)
colour_17 = ColourPicker(PickedColour=RGB(20, 3, 0))
multiplication_40 = Multiplication(A=matrix_31, B=multiplication_37)
multiplication_41 = Multiplication(A=number_slider_51, B=multiplication_36)
multiplication_42 = Multiplication(A=multiplication_40, B=multiplication_41)
matrix_58 = DisplayMatrix(multiplication_40, Digits=2)
panel_62 = Panel("1/fact(5) (tZ^5)")
fac_4 = Factorial(Number=Slider(5, range=0..10))
division_9 = Division(A=Slider(1, range=0..1), B=fac_4)
multiplication_43 = Multiplication(A=multiplication_42, B=division_9)
addition_11 = Addition(A=multiplication_43, B=addition_10)
matrix_59 = DisplayMatrix(addition_11, Digits=2)
multiplication_44 = Multiplication(A=matrix_31, B=multiplication_40)
multiplication_45 = Multiplication(A=number_slider_51, B=multiplication_41)
multiplication_46 = Multiplication(A=multiplication_44, B=multiplication_45)
matrix_60 = DisplayMatrix(multiplication_44, Digits=2)
panel_63 = Panel("1/fact(6) (tZ^6)")
fac_5 = Factorial(Number=Slider(6, range=0..10))
panel_64 = Panel("Hierarchical Structure")
division_10 = Division(A=Slider(1, range=0..1), B=fac_5)
matrix_61 = DisplayMatrix(matrix_31, Digits=2)
multiplication_47 = Multiplication(A=multiplication_46, B=division_10)
addition_12 = Addition(A=multiplication_47, B=addition_11)
item = ListItem(List=flatten(addition_12), Index=0, Wrap=True)
item_2 = ListItem(List=flatten(addition_12), Index=Slider(1, range=0..10), Wrap=True)
item_3 = ListItem(List=flatten(addition_12), Index=Slider(2, range=0..10), Wrap=True)
item_4 = ListItem(List=flatten(addition_12), Index=Slider(6, range=0..10), Wrap=True)
item_5 = ListItem(List=flatten(addition_12), Index=Slider(5, range=0..10), Wrap=True)
item_6 = ListItem(List=flatten(addition_12), Index=Slider(3, range=0..10), Wrap=True)
item_7 = ListItem(List=flatten(addition_12), Index=Slider(7, range=0..10), Wrap=True)
item_8 = ListItem(List=flatten(addition_12), Index=Slider(4, range=0..10), Wrap=True)
item_9 = ListItem(List=flatten(addition_12), Index=Slider(8, range=0..10), Wrap=False)
matrix_62 = DisplayMatrix(item, Digits=2)
matrix_63 = DisplayMatrix(item_3, Digits=2)
matrix_64 = DisplayMatrix(item_2, Digits=2)
matrix_65 = DisplayMatrix(item_4, Digits=2)
matrix_66 = DisplayMatrix(item_5, Digits=2)
matrix_67 = DisplayMatrix(item_6, Digits=2)
matrix_68 = DisplayMatrix(item_7, Digits=2)
matrix_69 = DisplayMatrix(item_9, Digits=2)
matrix_70 = DisplayMatrix(item_8, Digits=2)
number_slider_61 = Slider(0.5, range=0..10)
number_slider_62 = Slider(15, range=0..100)
number_slider_63 = Slider(15, range=0..100)
Z_15 = UnitZ(Factor=number_slider_61)
U = UCount(number_slider_62)
sph_2 = Sphere(Base=PlaneXY(0, 0, 0), Radius=number_slider_61)
brep = Brep(sph_2)
sec = BrepPlane(Brep=brep, Plane=rotate.Geometry)  # -> Curves, Points
crv_cp = CurveClosestPoint(Point=pt_11, Curve=reparameterize(sec.Curves))  # -> Point, Parameter, Distance
sec_2 = BrepPlane(Brep=brep, Plane=xy_7)  # -> Curves, Points; disabled
seam = Seam(Curve=reparameterize(sec.Curves), Seam=crv_cp.Parameter)
divide_2 = DivideCurve(Curve=seam, Count=merge_49, Kinks=False)  # -> Points, Tangents, Parameters
lng = ListLength(List=divide_2.Points)
panel_65 = Panel(lng)
divide_3 = DivideCurve(Curve=sec_2.Curves, Count=number_slider_60, Kinks=False)  # -> Points, Tangents, Parameters; disabled
division_11 = Division(A=lng, B=Slider(2, range=0..10))
pline = PolyLine(Vertices=divide_2.Points, Closed=True)
explode = Explode(Curve=pline, Recursive=True)  # -> flatten(Segments), Vertices
cyl_2 = Cylinder(Base=explode.Segments, Radius=expr(".3*x", number_slider_59), Length=explode.Segments)
pline_2 = PolyLine(Vertices=divide_3.Points, Closed=True)  # disabled
round = Round(Number=division_11)  # -> Nearest, Floor, Ceiling
cap_2 = CapHoles(Brep=cyl_2)
series_8 = Series(Start=1, Step=1, Count=expr("x-1", round.Ceiling))
panel_66 = Panel(series_8)
subtraction_3 = Subtraction(A=lng, B=series_8)
item_10 = ListItem(List=divide_2.Points, Index=subtraction_3, Wrap=True)
sph_3 = Sphere(Base=flatten(item_10), Radius=number_slider_59)
preview_15 = CustomPreview(Geometry=sph_3, Material=colour_15)
item_11 = ListItem(List=divide_2.Points, Index=series_8, Wrap=True)
sph_4 = Sphere(Base=flatten(item_11), Radius=number_slider_59)
preview_16 = CustomPreview(Geometry=sph_4, Material=colour_16)
preview_17 = CustomPreview(Geometry=cap_2, Material=colour_14)
preview_18 = CustomPreview(Geometry=[pline_2, pline], Material=colour_17)
move_22 = Move(Geometry=sph_2, Motion=Z_15)  # -> Geometry, Transform
sdivide = DivideSurface(Surface=sph_2, UCount=U, VCount=number_slider_62)  # -> simplify(flatten(Points)), Normals, Parameters
sdivide_2 = DivideSurface(Surface=sph_2, UCount=U, VCount=number_slider_62)  # -> simplify(Points), Normals, Parameters
colour_18 = ColourPicker(PickedColour=RGBA(79, 80, 76, 32))
preview_19 = CustomPreview(Geometry=sph_2, Material=colour_18)
pt_12 = ConstructPoint(XCoordinate=0.5, YCoordinate=0, ZCoordinate=0)
multiplication_48 = Multiplication(A=sdivide.Points, B=item_9)  # -> simplify(Result)
multiplication_49 = Multiplication(A=pt_12, B=item)
dematrix_7 = DeconstructMatrix(Matrix=multiplication_48)  # -> Rows, Columns, flatten(Values)
dematrix_8 = DeconstructMatrix(Matrix=multiplication_49)  # -> Rows, Columns, Values
partition = PartitionList(List=dematrix_7.Values, Size=3)  # -> simplify(Chunks)
multiplication_50 = Multiplication(A=pt_12, B=item_2)
num2pt_6 = NumbersToPoints(Numbers=dematrix_8.Values, Mask=4)
num2pt_7 = NumbersToPoints(Numbers=partition, Mask=4)
vec2pt_10 = Vector2Pt(PointA=simplify(sdivide.Points), PointB=simplify(flatten(num2pt_7)), Unitize=True)  # -> Vector, Length
multiplication_51 = Multiplication(A=multiplication_50, B=item_3)
dematrix_9 = DeconstructMatrix(Matrix=multiplication_50)  # -> Rows, Columns, Values
multiplication_52 = Multiplication(A=vec2pt_10.Vector, B=Slider(0.15, range=0..1))
multiplication_53 = Multiplication(A=multiplication_51, B=item_6)
dematrix_10 = DeconstructMatrix(Matrix=multiplication_51)  # -> Rows, Columns, Values
move_23 = Move(Geometry=sdivide.Points, Motion=multiplication_52)  # -> Geometry, Transform
flip_3 = FlipMatrix(Data=sdivide_2.Points)
series_9 = Series(Start=0, Step=expr("x-2", U), Count=U)
num2pt_8 = NumbersToPoints(Numbers=dematrix_9.Values, Mask=4)
dematrix_11 = DeconstructMatrix(Matrix=multiplication_53)  # -> Rows, Columns, Values
subtraction_4 = Subtraction(A=U, B=Slider(3, range=0..10))
num2pt_9 = NumbersToPoints(Numbers=dematrix_10.Values, Mask=4)
flip_4 = FlipMatrix(Data=flip_3)
item_12 = ListItem(List=flip_3, Index=0, Wrap=True)  # -> flatten(Item)
num2pt_10 = NumbersToPoints(Numbers=dematrix_11.Values, Mask=4)
dom_5 = ConstructDomain(DomainStart=0, DomainEnd=1)

subset = SubList(List=move_23.Geometry, Domain=subtraction_4, Wrap=True)  # -> List, Index
colour_19 = ColourPicker(PickedColour=RGBA(43, 0, 0, 129))
intcrv = Interpolate(Vertices=subset.List, Degree=3, Periodic=False, KnotStyle=1)  # -> Curve, Length, Domain
vdisex_6 = VectorDisplayEx(Point=sdivide.Points, Vector=multiplication_52, Colour=colour_19, Width=3)

colour_20 = ColourPicker(PickedColour=RGB(0, 0, 0))
preview_20 = CustomPreview(Geometry=intcrv.Curve, Material=colour_20)
panel_67 = Panel("Prepositions")
panel_68 = Panel("Conjunctions")
panel_69 = Panel("Adjectives")

# ==== cluster Cluster
A = ClusterInput()
B = ClusterInput()
multiplication = Multiplication(A=A, B=B)
division = Division(A=multiplication, B=Slider(2, range=0..10, expression="-x"))
addition = Addition(A=division, B=Slider(0, range=0..20))
pt = ConstructPoint(XCoordinate=addition, YCoordinate=division, ZCoordinate=0)
pt_2 = ClusterOutput(pt)
